# Grasshopper definition toolpath_flow-modulator_beta-19.gh (Grasshopper 1.0.8)
# plug-ins: Toolpaths.Fdm, Toolpaths.Gh

# ----
# input geometry: cylinder
number_slider = Slider(40, range=0..100)
# TOOLPATHS
# developed by JÜNGERKÜHN
# contact: toolpaths@juengerkuehn.com
# juengerkuehn.com
# github.com/KonradJuenger/TOOLPATHS
xy = XYPlane(Origin=Point(0, 0, 0))
cyl = Cylinder(Base=xy, Radius=number_slider, Length=Slider(130, range=0..1000))

layerheight = Slider(3, range=0..10)
layerheight_2 = Number(layerheight)

# ----
# vase mode
layerheight_3 = Number(layerheight_2)

fdm_vase = FDMVaseModeGenerator(
    Geometry=cyl,
    LayerHeight=layerheight_3,
    BaseThickness=Slider(0.4, range=0..1),
    Divisions=Slider(106, range=0..1000),
    StaggerCycle=Slider(2, range=0..10),
    PitchMode=0,
    SamplingMode=Slider(0, range=0..1),
    SamplingDistance=1,
    AutoShear=False)  # -> HelixCurve, UnsampledCurve, TopCurves, BottomCurves

layerheight_4 = Number(layerheight_2)
# toolpath object wih volume mode
e_mode = EMode({"Volume": 0, "Auto Width": 1, "Auto Ratio": 2, "Static": 3, "No Extrusion": 4}, selected="Volume")
multiplication = Multiplication(A=layerheight_4, B=Slider(1.3, range=0..10))
extrvolume = FDMExtrusionVolume(Width=multiplication, Height=layerheight_4)
fdm_toolpath = FDMToolpath(Curve=fdm_vase.HelixCurve, EMode=e_mode, Volume=extrvolume)

# ----
# mask modulator
geo = Geometry(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)
len = Length(Curve=geo)
maskgradient = MaskGradient(Input=fdm_toolpath, Mode=0, Base=geo, Wavelength=len)

# ----
# modulate flow
panel = Panel("""0.1
0.1
1
1""")
mod_flow = ModulatorFlow(Input=fdm_toolpath, Scales=panel, VertexMappingStrategy=2, Mask=maskgradient)

# ----
# process settings
number_slider_2 = Slider(0.3, range=0..1)
# machine settings
number_slider_3 = Slider(5, range=0..10)
defaults = FDMDefaults(
    HeightfieldResolution=number_slider_2,
    SafeClearance=Slider(6, range=0..10),
    ZHopHeight=Slider(2, range=0..10),
    MeshingResolution=Slider(0.4, range=0..1),
    SmoothingWindow=Slider(1, range=0..100),
    DegenerateAspectRatio=Slider(20, range=0..100),
    MinLayerHeight=Slider(0.1, range=0..0.1),
    MaxLayerHeight=number_slider_3)

extruder = FDMExtruder(
    ExtruderNumber=0,
    NozzleDiameter=Slider(2, range=0..10),
    FilamentDiameter=1.75,
    PrintMaterial=ColourSwatch(SwatchColor=RGB(141, 150, 214)))
box = Box({Plane=Plane(origin=(0, 300, 0), x=(1, 0, 0), y=(0, -1, 0)), X=Domain(0, 300), Y=Domain(0, 300), Z=Domain(-400, 0)})
machine = FDMMachine(
    G0RapidSpeed=200,
    MaxZSpeed=6,
    MachineBounds=box,
    Extruders=extruder,
    EPosAbsRel=0,
    HomeBeforePrint=False,
    CenterPrintXY=Toggle(True))

processor = FDMProcessor(Toolpaths=mod_flow, Machine=machine, Defaults=defaults)  # -> SimulationData, Errors, Warnings
machine_2 = Machine({"Klipper": "klipper", "RepRap": "reprap", "Prusa": "prusa", "Bambu": "bambu"}, selected="RepRap")

# ----
# use the color componet to define custom colors
swatch = ColourSwatch(SwatchColor=RGB(252, 254, 255))
colors = Colors(FDMTravel=swatch)

fdm_g_code = FDMGCodeOutput(
    SimulationData=processor.SimulationData,
    MachineType=machine_2,
    Save=Button(),
    Upload=False,
    StartPrint=False,
    OutputGCode=False)  # -> GCode, Toolpath, Info, VerboseDebug, ToolpathDebug

# ----
# FDM simulator creates a scrubbable preview from all processed toolpaths
toggle = BooleanToggle(False)
# SIMULATE + GCODE
number_slider_4 = Slider(1, range=0..1)
fdm_sim = FDMSimulator(
    SimulationData=processor.SimulationData,
    Time=number_slider_4,
    Play=toggle,
    Speed=Slider(1, range=0.3..3),
    StadiumSegments=3,
    BakeMeshes=False,
    Colors=colors)  # -> CurrentTime, Meshes, ToolPosition, ProgramDuration

panel_2 = Panel(fdm_g_code.Info)
