# Grasshopper definition toolpath_image_map-beta-24.gh (Grasshopper 1.0.8)
# plug-ins: Toolpaths.Fdm, Toolpaths.Gh

# ----
# TOOLPATHS
# developed by JÜNGERKÜHN
# contact: toolpaths@juengerkuehn.com
# juengerkuehn.com
# github.com/KonradJuenger/TOOLPATHS
# create base geometry
geo = Geometry(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)
geo_2 = Geometry(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)
revsrf = Revolution(Curve=geo, Axis=geo_2, Domain=Domain(0, 6.283185307))

# ----
# vase mode spiral path
number_slider = Slider(1.5, range=0..10)
mode = Mode({"Angle": 0, "Length": 1}, selected="Angle")
vase_options = FDMVaseOptions(SamplingMode=mode, Divisions=Slider(120, range=0..1000))
fdm_vase = FDMVaseModeGenerator(Geometry=revsrf, LayerHeight=number_slider, ExtrusionWidth=1.5, Options=vase_options)  # -> Toolpath, HelixCurve, UnsampledCurve, TopCurves, BottomCurves
# create toolpath object
# with auto width
e_mode = EMode({"Volume": 0, "Auto Width": 1, "Auto Ratio": 2, "Static": 3, "No Extrusion": 4}, selected="Auto Width")

fdm_toolpath = FDMToolpath(Curve=fdm_vase.HelixCurve, EMode=e_mode, Volume=Slider(1.27, range=0..10), EWidth=Slider(4.839, range=0..10))

bbox = BoundingBox(Content=fdm_toolpath, Plane=PlaneXY(0, 0, 0), UnionBox=True)  # -> Box, Box_2
volume = Volume(Geometry=bbox.Box)  # -> Volume, Centroid
# "bounding" cylinder
debox = DeconstructBox(Box=bbox.Box)  # -> Plane, X, Y, Z
pdecon = Deconstruct(Point=volume.Centroid)  # -> XComponent, YComponent, ZComponent
dedomain = DeconstructDomain(Domain=debox.X)  # -> Start, End
dedomain_2 = DeconstructDomain(Domain=debox.Y)  # -> Start, End
dedomain_3 = DeconstructDomain(Domain=debox.Z)  # -> Start, End
subtraction = Subtraction(A=dedomain_2.End, B=dedomain_2.Start)
subtraction_2 = Subtraction(A=dedomain.End, B=dedomain.Start)
subtraction_3 = Subtraction(A=dedomain_3.End, B=dedomain_3.Start)
pt = ConstructPoint(XCoordinate=pdecon.XComponent, YCoordinate=pdecon.YComponent, ZCoordinate=0)
max = Maximum(A=subtraction_2, B=subtraction)
xy = XYPlane(Origin=pt)
cyl = Cylinder(Base=xy, Radius=max, Length=subtraction_3)

# ----
# get the brightness values of the corresponding vert / pixel pairs
decon_fdm = DeconstructFDMToolpath(Toolpath=fdm_toolpath)  # -> Path, Speed, Flow, EMode, Volume, Vertices
srf_cp = SurfaceClosestPoint(Point=decon_fdm.Vertices, Surface=reparameterize(cyl))  # -> Point, UVPoint, Distance
vec = VectorXYZ(XComponent=Slider(2, range=0..10), YComponent=Slider(0.9, range=0..1), ZComponent=0)  # -> Vector, Length
multiplication = Multiplication(A=srf_cp.UVPoint, B=vec.Vector)
image = ImageSampler(
    multiplication,
    FilePath="D:\01_Projekte\00_current_projects\JK_toolpaths\Substance_graph_output_5.png",
    Filter="Value",
    Interpolate=True,
    Umax=1,
    Umin=0,
    Vmax=1,
    Vmin=0,
    Wrap=1)

defaults = FDMDefaults(
    HeightfieldResolution=Slider(0.2, range=0..1),
    SafeClearance=Slider(6, range=0..10),
    ZHopHeight=Slider(2, range=0..10),
    MeshingResolution=Slider(0.4, range=0..1),
    SmoothingWindow=Slider(1, range=0..100),
    DegenerateAspectRatio=Slider(10, range=0..10),
    MaxLayerHeight=Slider(3.072, range=0..10))

# ----
# use the pixel bightness as a modulator
neg = Negative(Value=Slider(9.786, range=0..20))
dom = ConstructDomain(DomainStart=neg, DomainEnd=Slider(0, range=0..10))
remap = RemapNumbers(Value=image, Source=Domain(0, 1), Target=dom)  # -> Mapped, Clipped
mod_ndisp = ModulatorNormalDisplacement(Input=fdm_toolpath, Distances=remap.Mapped, VertexMappingStrategy=2, Mode=0)

extruder = FDMExtruder(
    ExtruderNumber=0,
    NozzleDiameter=Slider(1.5, range=0..10),
    FilamentDiameter=1.75,
    PrintMaterial=ColourSwatch(SwatchColor=RGB(114, 132, 158)))
machine = FDMMachine(G0RapidSpeed=200, MaxZSpeed=6, Extruders=extruder, EPosAbsRel=0, HomeBeforePrint=False, CenterPrintXY=False)

mode_2 = ProcessorMode({"Hybrid": 2, "Preview": 1, "Simulation": 0}, selected="Hybrid")
processor = FDMProcessor(Toolpaths=mod_ndisp, Machine=machine, Defaults=defaults, ProcessorMode=mode_2)  # -> SimulationData, Errors, Warnings
mode_3 = ProcessorMode({"Hybrid": 2, "Preview": 1, "Simulation": 0}, selected="Hybrid")
fdm_sim = FDMSimulator(
    SimulationData=processor.SimulationData,
    Time=Slider(1, range=0..1),
    Play=False,
    Speed=1,
    StadiumSegments=3,
    BakeMeshes=False,
    ProgressOverlay=True,
    DisablePreview=False)  # -> CurrentTime, Meshes, ToolPosition, ProgramDuration
