# Grasshopper definition toolpath_nonplanar-slicing_beta-15.gh (Grasshopper 1.0.8)
# plug-ins: Toolpaths.Fdm, Toolpaths.Gh

# ----
# TOOLPATHS
# developed by JÜNGERKÜHN
# contact: toolpaths@juengerkuehn.com
# juengerkuehn.com
# github.com/KonradJuenger/TOOLPATHS
# 1. transform mesh to a shape that can be sliced planarly
mesh = Mesh(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)
geo = Geometry(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)
planar_transform = PlanarTransform(Mesh=mesh, BaseUpper=geo, GridCellSize=5)  # -> PlanarMesh, TransformData, Warnings

# ----
# How to get the top base surface?
mesh_2 = Mesh(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)

toggle = BooleanToggle(True)
# 2. use any method to generate curves or toolpaths
fdm_vase = FDMVaseModeGenerator(
    Geometry=planar_transform.PlanarMesh,
    LayerHeight=Slider(3, range=0..10),
    Pitch=toggle,
    SamplingMode=toggle,
    Divisions=24,
    Length=1,
    AlternatingPattern=False)  # -> Curves, UnresampledCurve, StartCurves, EndCurves
fdm_toolpath = FDMToolpath(Curve=fdm_vase.Curves, EWidth=Slider(6, range=0..10))

medges = MeshEdges(Mesh=mesh_2)  # -> NakedEdges, InteriorEdges, NonManifoldEdges
join = JoinCurves(Curves=medges.NakedEdges, Preserve=False)
pcen = PolygonCenter(Polyline=join)  # -> CenterV, CenterE, CenterA
pdecon = Deconstruct(Point=pcen.CenterV)  # -> XComponent, YComponent, ZComponent
# Use the patch command to create a surface that matches the top of your shape
sort = SortList(Keys=pdecon.ZComponent, ValuesA=join)  # -> Keys, ValuesA
rev = ReverseList(List=sort.ValuesA)
item = ListItem(List=rev, Index=0, Wrap=True)
patch = Patch(Curves=item, Spans=20, Flexibility=1, Trim=Toggle(False))
# c# script to extend the surface
number_slider = Slider(26, range=0..100)
c_script = CSharpScript(S=patch, D=number_slider)  # -> out, a; inputs S: Surface, D: Double
# ---------- c_script: C# ----------
// Grasshopper Script Instance
#region Usings
using System;
using System.Linq;
using System.Collections;
using System.Collections.Generic;
using System.Drawing;

using Rhino;
using Rhino.Geometry;

using Grasshopper;
using Grasshopper.Kernel;
using Grasshopper.Kernel.Data;
using Grasshopper.Kernel.Types;
#endregion

public class Script_Instance : GH_ScriptInstance
{
    #region Notes
    /* 
      Members:
        RhinoDoc RhinoDocument
        GH_Document GrasshopperDocument
        IGH_Component Component
        int Iteration

      Methods (Virtual & overridable):
        Print(string text)
        Print(string format, params object[] args)
        Reflect(object obj)
        Reflect(object obj, string method_name)
    */
    #endregion

private void RunScript(Surface S, double D, ref object a)
{
  // 1. Check for null input
  if (S == null) 
  {
    Component.AddRuntimeMessage(GH_RuntimeMessageLevel.Warning, "Input S is null.");
    return;
  }

  // 2. Logic
  // Surface.Extend returns a NEW surface.
  Surface res = S;
  IsoStatus[] sides = { IsoStatus.North, IsoStatus.South, IsoStatus.East, IsoStatus.West };

  foreach (IsoStatus side in sides) 
  {
    // Extend returns a new surface or null if it fails
    Surface temp = res.Extend(side, D, true);
    if (temp != null) res = temp;
  }

  // 3. Assign to output (Note lowercase 'a' to match signature)
  a = res;
}
}
# ---------- end c_script ----------

# ----
# 3. untransfrom the toolpaths to match the orginal shape
non_planar_transform = NonPlanarTransform(Input=fdm_toolpath, TransformData=planar_transform.TransformData)  # -> Output, Warnings
planar_transform_2 = PlanarTransform(Mesh=mesh_2, BaseUpper=c_script.a, GridCellSize=5)  # -> PlanarMesh, TransformData, Warnings

machine = FDMMachine(
    NozzleDiameter=Slider(6, range=0..10),
    FilamentDiameter=1.75,
    G0RapidSpeed=200,
    MaxZSpeed=6,
    EPosAbsRel=0,
    HomeBeforePrint=False,
    CenterPrintXY=False)

defaults = FDMDefaults(
    HeightfieldResolution=Slider(0.3, range=0..1),
    SafeClearance=Slider(6, range=0..10),
    ZHopHeight=Slider(2, range=0..10),
    MeshingResolution=Slider(0.5, range=0..1),
    SmoothingWindow=Slider(1, range=0..100),
    DegenerateAspectRatio=Slider(20, range=0..100),
    MinLayerHeight=Slider(0.1, range=0..0.1),
    MaxLayerHeight=Slider(4.4, range=0..10))

processor = FDMProcessor(Toolpaths=non_planar_transform.Output, Machine=machine, Defaults=defaults, HFTime=-1, DebugOutputs=False)  # -> SimulationData, Errors, Warnings, HFPoints, SamplePoints, SampleHeights, TripleProbeTree

# ----
# use baking to output actual geometry to grasshopper. (slow)
toggle_2 = BooleanToggle(False)

# ----
# use the color componet to define custom colors
swatch = ColourSwatch(SwatchColor=RGB(90, 158, 242))
colors = Colors(FDMExtrusion=swatch, FDMTravel=ColourSwatch(SwatchColor=RGB(252, 254, 255)))

# ----
# increase the segement count to make the extrusion mesh rounder
number_slider_2 = Slider(3, range=0..10)

# ----
# FDM simulator
number_slider_3 = Slider(1, range=0..1)

fdm_sim = FDMSimulator(
    SimulationData=processor.SimulationData,
    Time=number_slider_3,
    Play=Toggle(False),
    Speed=1,
    StadiumSegments=number_slider_2,
    BakeMeshes=toggle_2,
    Colors=colors)  # -> CurrentTime, Meshes, ToolPosition, ProgramDuration
