# Grasshopper definition toolpath_robot-output_beta-16.gh (Grasshopper 1.0.8)
# plug-ins: Robots, Toolpaths.Fdm

extruder = FDMExtruder(ExtruderNumber=0, NozzleDiameter=Slider(4, range=0..10), FilamentDiameter=1.75, PrintMaterial=RGB(100, 149, 237))
machine = FDMMachine(
    G0RapidSpeed=200,
    MaxZSpeed=6,
    Extruders=extruder,
    EPosAbsRel=Slider(1, range=0..1),
    HomeBeforePrint=False,
    CenterPrintXY=Toggle(False))

# ----
# TOOLPATHS
# developed by JÜNGERKÜHN
# contact: toolpaths@juengerkuehn.com
# juengerkuehn.com
# github.com/KonradJuenger/TOOLPATHS
geo = Geometry([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])
fdm_toolpath = FDMToolpath(Curve=geo, Volume=Slider(3, range=0..10))

defaults = FDMDefaults(ZHopHeight=Slider(50, range=0..100), SafeClearance=Slider(80, range=0..100))

processor = FDMProcessor(Toolpaths=fdm_toolpath, Machine=machine, Defaults=defaults)  # -> SimulationData, Errors, Warnings

# ----
# tcp
# tool oriented sideways
# to avoid wrist singularity
panel = Panel("0,0,1")
tool_weight = Panel("6.0")
pt = Point(Point(137.8363948, 2.467293384e-06, 44.59797803))
mesh = Mesh(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)
tool_name = Panel("Extruder")
pl = ConstructPlane(Origin=pt, XAxis="0,1,0", YAxis=panel)
tool = CreateTool(Name=tool_name, TCP=pl, Weight=tool_weight, Mesh=mesh)  # -> Tool, TCP

fdmrobot = FDMRobotsOutput(SimulationData=processor.SimulationData, Orientation=Slider(1, range=0..10), Behavior=1)  # -> Planes, Speeds, Extrusion, ExtrusionSpeed, Types
list = RobotsLibrary(
    {"Franka Emika Panda", "Bartlett-IRB120", "Bartlett-IRB1600", "Bartlett-KR6", "Bartlett-KR60-A", "Bartlett-KR60-B", "Bartlett-KR500", "Bartlett-KR60 on track", "Bartlett-UR10", "Bartlett-KR60", "Bartlett-TX200", "Bartlett-TX200L", "Bartlett-RX160", "Bartlett-RX160L", "UR3e", "UR5e", "UR10e", "UR16e", "UR3", "UR5", "UR10", "UR20", "UR30"}, selected="UR5e",
    Type=0)
list_2 = FlagFields({"Shoulder": 1, "Elbow": 2, "Wrist": 4}, selected="Wrist")
list_3 = ValueList({"Joint", "Linear"}, selected="Linear")
target = CreateTarget(Plane=fdmrobot.Planes, RobConf=list_2, Motion=list_3, Tool=tool.Tool, Speed=fdmrobot.Speeds, IsCartesian=True)
loadrobot = LoadRobotSystem(Name=list, Base=PlaneXY(0, 0, 0))
program = CreateProgram(Name="DefaultProgram", RobotSystem=loadrobot, Targets=target, StepSize=1)  # -> Program, Code, Duration, Warnings, Errors
number_slider = Slider(1, range=0..1)
sim = ProgramSimulation(Program=program.Program, Time=number_slider, Normalized=True)  # -> SystemMeshes, JointRotations, Plane, Index, Time, Program, Errors
fdm_sim = FDMSimulator(SimulationData=processor.SimulationData, Time=number_slider, Play=False, Speed=1, StadiumSegments=3, BakeMeshes=False)  # -> CurrentTime, Meshes, ToolPosition, ProgramDuration
