# Grasshopper definition toolpath_simple_multiextruder-beta-16.gh (Grasshopper 1.0.8)
# plug-ins: Toolpaths.Fdm, Toolpaths.Gh

# vase mode
geo = Geometry(Point(51.48022216, 23.497599, 0))

# ----
# base geometry
number_slider = Slider(10, range=0..100)
xy = XYPlane(Origin=geo)
cyl = Cylinder(Base=xy, Radius=number_slider, Length=Slider(23, range=0..100))

_0 = Integer(0)

# ----
# TOOLPATHS
# developed by JÜNGERKÜHN
# contact: toolpaths@juengerkuehn.com
# juengerkuehn.com
# github.com/KonradJuenger/TOOLPATHS
# basic planar slicing
# create planar slice curves
# create wall curves
# create infill curves
# create toolpath object
input_geo = Geometry(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)
planar_slice = FDMPlanarSliceGenerator(Geometry=input_geo, LayerHeight=1, MaxSegmentLength=0.3)
list = ValueList({"Monotonic": 0, "Monotonic (Connected)": 1, "Gyroid": 2, "Gyroid (Connected)": 3}, selected="Monotonic (Connected)")
fdm_walls = FDMWallsGenerator(Curves=planar_slice, LineWidth=Slider(2, range=0..10), Count=Slider(2, range=0..10), InfillOffset=0)  # -> Curves, InfillCurves
vec = Vector(Vector(9.385319152, 10.3421104, 0))
fdm_infill = FDMInfillGenerator(InfillCurves=fdm_walls.InfillCurves, Direction=vec, InfillSpacing=2, MinLength=0, InfillType=list)
merge = Merge(Data1=fdm_walls.Curves, Data2=fdm_infill)
fdm_toolpath = FDMToolpath(Curve=merge, Extruder=_0, EWidth=Slider(2, range=0..10))

_1 = Integer(1)

# ----
# extruder 0
number_slider_2 = Slider(1.5, range=0..10)
# extruder 1
number_slider_3 = Slider(1.5, range=0..10)
_0_2 = Integer(0)
_1_2 = Integer(1)
extruder = FDMExtruder(
    ExtruderNumber=_0_2,
    NozzleDiameter=number_slider_2,
    FilamentDiameter=1.75,
    PrintMaterial=ColourSwatch(SwatchColor=RGB(109, 160, 247)))
extruder_2 = FDMExtruder(
    ExtruderNumber=_1_2,
    NozzleDiameter=number_slider_3,
    FilamentDiameter=1.75,
    PrintMaterial=ColourSwatch(SwatchColor=RGB(237, 78, 78)))
machine = FDMMachine(
    G0RapidSpeed=200,
    MaxZSpeed=6,
    Extruders=[extruder, extruder_2],
    EPosAbsRel=0,
    HomeBeforePrint=False,
    CenterPrintXY=False)

defaults = FDMDefaults(
    HeightfieldResolution=Slider(0.3, range=0..1),
    SafeClearance=Slider(6, range=0..10),
    ZHopHeight=Slider(2, range=0..10),
    MeshingResolution=Slider(0.4, range=0..1),
    SmoothingWindow=Slider(1, range=0..100),
    DegenerateAspectRatio=Slider(2.723, range=0..10),
    MaxLayerHeight=Slider(3.072, range=0..10))

# ----
# increase the segement count to make the extrusion mesh rounder
number_slider_4 = Slider(3, range=0..10)

# ----
# use the color componet to define custom colors
swatch = ColourSwatch(SwatchColor=RGB(90, 158, 242))
# Gcode output
swatch_2 = ColourSwatch(SwatchColor=RGB(252, 254, 255))
colors = Colors(FDMExtrusion=swatch, FDMTravel=swatch_2)

# ----
# use baking to output actual geometry to grasshopper. (slow)
toggle = BooleanToggle(False)

number_slider_5 = Slider(1, range=0.3..3)
machine_2 = Machine({"Klipper": "klipper", "RepRap": "reprap", "Prusa": "prusa", "Bambu": "bambu"}, selected="Klipper")

# ----
# generate vase mode  path
# shift start generates planar slices for the first layers
# planar slice for the first layers
number_slider_6 = Slider(2.326, range=0..10)
list_2 = ValueList({"Monotonic": 0, "Monotonic (Connected)": 1, "Gyroid": 2, "Gyroid (Connected)": 3}, selected="Monotonic (Connected)")

fdm_vase = FDMVaseModeGenerator(
    Geometry=cyl,
    LayerHeight=1,
    Pitch=0,
    SamplingMode=0,
    Divisions=24,
    Length=1,
    AlternatingPattern=False,
    BaseThickness=number_slider_6)  # -> Curves, UnresampledCurve, StartCurves, EndCurves

fdm_walls_2 = FDMWallsGenerator(
    Curves=fdm_vase.StartCurves,
    LineWidth=Slider(2, range=0..10),
    Count=1,
    InfillOffset=0,
    ManualOffsets=Slider(0, range=0..100))  # -> Curves, InfillCurves
fdm_infill_2 = FDMInfillGenerator(InfillCurves=fdm_walls_2.InfillCurves, InfillSpacing=2, MinLength=0, InfillType=list_2)
merge_2 = Merge(Data1=fdm_vase.Curves, Data2=fdm_walls_2.Curves, Data3=fdm_infill_2)
fdm_toolpath_2 = FDMToolpath(Curve=merge_2, Extruder=_1, EWidth=Slider(2, range=0..10))

merge_3 = Merge(Data1=flatten(fdm_toolpath), Data2=flatten(fdm_toolpath_2))
processor = FDMProcessor(Toolpaths=merge_3, Machine=machine, Defaults=defaults)  # -> SimulationData, Errors, Warnings

# ----
# SIMULATE + GCODE
# FDM simulator creates a scrubbable preview from all processed toolpaths
# playback controls
number_slider_7 = Slider(1, range=0..1)
toggle_2 = BooleanToggle(False)
fdm_sim = FDMSimulator(
    SimulationData=processor.SimulationData,
    Time=number_slider_7,
    Play=False,
    Speed=1,
    StadiumSegments=number_slider_4,
    BakeMeshes=toggle,
    Colors=colors)  # -> CurrentTime, Meshes, ToolPosition, ProgramDuration

# ----
# select machine type
# select a DIRECTORY to save the file
# by default it saves to the desktop
# upload works for klipper and reprap
# start printing after upload?
# path to a 3mf file used as a template bambu files
print_after_upload = BooleanToggle(False)
path = FilePath()
upload = Button()
ouput_gcode_to_gh = BooleanToggle(False)
save = Button()
path_2 = FilePath()
fdm_g_code = FDMGCodeOutput(
    SimulationData=processor.SimulationData,
    MachineType=machine_2,
    Save=save,
    Upload=upload,
    PrinterIPAddress="192.168.0.101",
    StartPrint=print_after_upload,
    OutputGCode=ouput_gcode_to_gh)  # -> GCode, Toolpath, Info, VerboseDebug, ToolpathDebug

mesh = Mesh(fdm_sim.Meshes)
panel = Panel(fdm_g_code.Info)
