# Grasshopper definition toolpath_variable_infill-beta-24.gh (Grasshopper 1.0.8)
# plug-ins: Toolpaths.Fdm, Toolpaths.Gh

# ----
# base geometry
number_slider = Slider(20, range=0..100)
# TOOLPATHS
# developed by JÜNGERKÜHN
# contact: toolpaths@juengerkuehn.com
# juengerkuehn.com
# github.com/KonradJuenger/TOOLPATHS
xy = XYPlane(Origin=Point(0, 0, 0))
cyl = Cylinder(Base=xy, Radius=number_slider, Length=Slider(14, range=0..100))

# ----
# create planar slice curves
number_slider_2 = Slider(0.4, range=0..1)

planar_slice = FDMPlanarSliceGenerator(Geometry=cyl, LayerHeight=number_slider_2, ExtrusionWidth=1.5)  # -> Toolpaths, SliceCurves

# ----
# create walls
number_slider_3 = Slider(2, range=0..10)
neg = Negative(Value=Slider(0.39, range=0..1))

list = ValueList({"Offset": 0, "Spiral": 1}, selected="Offset")
fdm_walls = FDMWallsGenerator(
    Curves=planar_slice.SliceCurves,
    LineWidth=number_slider_3,
    Count=Slider(1, range=0..10),
    WallType=list,
    ManualOffsets=neg)  # -> Curves, InfillCurves

# ----
# create infill curves
X = UnitX(Factor=1)
Y = UnitY(Factor=1)
merge = Merge(Data1=Y, Data2=X)
# alternating slicing direction
long = LongestList(ListA=flatten(fdm_walls.InfillCurves), ListB=merge, PaddingMode=4)  # -> ListA, graft(ListB)
match = MatchTree(Tree=long.ListB, Guide=fdm_walls.InfillCurves)

list_2 = ValueList({"Monotonic": 0, "Monotonic (Connected)": 1, "Gyroid": 2, "Gyroid (Connected)": 3}, selected="Monotonic")

list_3 = ValueList({"Monotonic": 0, "Monotonic (Connected)": 1, "Gyroid": 2, "Gyroid (Connected)": 3, "Spiral": 4}, selected="Monotonic")
# create infill
fdm_infill = FDMInfillGenerator(
    InfillCurves=fdm_walls.InfillCurves,
    Direction=match,
    InfillSpacing=Slider(4, range=0..10),
    MinLength=0,
    InfillType=list_3,
    InfillOffset=Slider(0.5, range=0..1))

# ----
# create more control points for mapping flow values onto
number_slider_4 = Slider(1, range=0..1)
curvedivide = CurveDivider(Curves=fdm_infill, SegmentLength=number_slider_4, SubdividePolylines=Toggle(True))

# ----
# initial volumetic flow
number_slider_5 = Slider(1.16, range=0..10)
fdm_toolpath = FDMToolpath(Curve=curvedivide, Volume=number_slider_5)

# ----
# walls with 2mm width
number_slider_6 = Slider(2, range=0..10)
fdm_toolpath_2 = FDMToolpath(Curve=fdm_walls.Curves, EWidth=number_slider_6)

# ----
# modulate flow
panel = Panel("""1
1
0.5
0.5
0.5
1
1""")
mod_flow = ModulatorFlow(Input=fdm_toolpath, Scales=panel, VertexMappingStrategy=Slider(5, range=0..10))

# ----
# combine walls and infill
merge_2 = Merge(Data1=fdm_toolpath_2, Data2=mod_flow)

defaults = FDMDefaults(
    HeightfieldResolution=Slider(0.3, range=0..1),
    SafeClearance=Slider(6, range=0..10),
    ZHopHeight=Slider(2, range=0..10),
    MeshingResolution=Slider(0.3, range=0..1),
    SmoothingWindow=Slider(17, range=0..100),
    DegenerateAspectRatio=Slider(20, range=0..100),
    MaxLayerHeight=Slider(4.4, range=0..10))

extruder = FDMExtruder(
    ExtruderNumber=0,
    NozzleDiameter=Slider(1.5, range=0..10),
    FilamentDiameter=1.75,
    PrintMaterial=ColourSwatch(SwatchColor=RGB(255, 255, 255)))
machine = FDMMachine(G0RapidSpeed=200, MaxZSpeed=6, Extruders=extruder, EPosAbsRel=0, HomeBeforePrint=False, CenterPrintXY=False)

mode = ProcessorMode({"Hybrid": 2, "Preview": 1, "Simulation": 0}, selected="Hybrid")
processor = FDMProcessor(Toolpaths=merge_2, Machine=machine, Defaults=defaults, ProcessorMode=mode)  # -> SimulationData, Errors, Warnings

# ----
# SIMULATE + GCODE
number_slider_7 = Slider(1, range=0..1)

# ----
# use the color componet to define custom colors
swatch = ColourSwatch(SwatchColor=RGB(162, 221, 250))
colors = Colors(FDMTravel=swatch)

fdm_sim = FDMSimulator(
    SimulationData=processor.SimulationData,
    Time=number_slider_7,
    Play=Toggle(False),
    Speed=Slider(1, range=0.3..3),
    StadiumSegments=3,
    BakeMeshes=False,
    Colors=colors,
    ProgressOverlay=True,
    DisablePreview=False)  # -> CurrentTime, Meshes, ToolPosition, ProgramDuration
