# Grasshopper definition toolpaths_generators.gh (Grasshopper 1.0.8)
# plug-ins: Toolpaths.Fdm

list = ValueList({"Offset": 0, "Spiral": 1}, selected="Offset")
list_2 = ValueList({"Offset": 0, "Spiral": 1}, selected="Offset")
list_3 = ValueList({"Monotonic": 0, "Monotonic (Connected)": 1, "Gyroid": 2, "Gyroid (Connected)": 3, "Spiral": 4}, selected="Monotonic (Connected)")

# ----
# infill generation
X = UnitX(Factor=1)
rotate = Rotate(Geometry=X, Angle=degrees(Slider(148, range=0..360)), Plane=PlaneXY(0, 0, 0))  # -> Geometry, Transform
geo = Geometry(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)
_2 = Integer(2)
fdm_infill = FDMInfillGenerator(InfillCurves=geo, Direction=rotate.Geometry, InfillSpacing=_2, MinLength=0, InfillType=list_3)
_2_2 = Integer(2)
fdm_toolpath = FDMToolpath(Curve=fdm_infill, EWidth=_2_2)

list_4 = ValueList({"Monotonic": 0, "Monotonic (Connected)": 1, "Gyroid": 2, "Gyroid (Connected)": 3, "Spiral": 4}, selected="Monotonic")
number = Number(0.3)
list_5 = ValueList({"Offset": 0, "Spiral": 1}, selected="Offset")
number_2 = Number(0.3)
_2_3 = Integer(2)
vase_options = FDMVaseOptions(BaseThickness=number)
# extend at start / end will dynamically extend the toolpath by the given distance.
# closed curves will loop around -- open curves will extend along the tangent
vase_options_2 = FDMVaseOptions(BaseThickness=number_2)
list_6 = ValueList({"Monotonic": 0, "Monotonic (Connected)": 1, "Gyroid": 2, "Gyroid (Connected)": 3, "Spiral": 4}, selected="Monotonic (Connected)")
list_7 = ValueList({"Offset": 0, "Spiral": 1}, selected="Offset")

# ----
# The FDM Processor uses these
#  values as defaults when they are
# not set on the Toolpath object.
number_slider = Slider(60, range=0..100)
# define process defaults
number_slider_2 = Slider(72, range=0..100)
defaults = FDMDefaults(Speed=number_slider_2, ExtruderTemperature=Slider(200, range=0..1000), BedTemperature=number_slider)

merge = Merge()
merge_2 = Merge()
merge_3 = Merge()
mode = ProcessorMode({"Hybrid": 2, "Preview": 1, "Simulation": 0}, selected="Hybrid")
path = FilePath()

# ----
# planar slice for the first layers
# base thickness generates planar slices for the first layers
number_slider_3 = Slider(2.237, range=0..10)
# vase mode
geo_2 = Geometry(Point(207.8120414, 24.6220849, 0))
_2_4 = Integer(2)

xy = XYPlane(Origin=geo_2)
cyl = Cylinder(Base=xy, Radius=Slider(10, range=0..100), Length=Slider(23, range=0..100))

vase_options_3 = FDMVaseOptions(BaseThickness=number_slider_3)
fdm_vase = FDMVaseModeGenerator(Geometry=cyl, LayerHeight=1, ExtrusionWidth=_2_4, Options=vase_options_3)  # -> Toolpath, HelixCurve, UnsampledCurve, TopCurves, BottomCurves
fdm_walls = FDMWallsGenerator(Curves=fdm_vase.BottomCurves, LineWidth=_2_3, Count=1, WallType=list_5, ManualOffsets=Slider(0, range=0..0.01))  # -> Curves, InfillCurves
fdm_infill_2 = FDMInfillGenerator(InfillCurves=fdm_walls.InfillCurves, InfillSpacing=2, MinLength=0, InfillType=list_6)

merge_4 = Merge(Data1=fdm_walls.Curves, Data2=fdm_infill_2)
fdm_toolpath_2 = FDMToolpath(Curve=merge_4, EWidth=Slider(2, range=0..10))

merge_5 = Merge(Data1=fdm_vase.Toolpath, Data2=fdm_toolpath_2)

xy_2 = XYPlane(Origin=Point(244.3094513, 21.29128915, 0))
# variable layer heigh based on slope
geo_3 = Geometry(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)
line = LineSDL(Start=xy_2, Direction=Vector(0, 0, 1), Length=1)
_1 = Mode(1)
revsrf = Revolution(Curve=geo_3, Axis=line, Domain=Domain(0, 6.283185307))

lh_field = FDMLayerHeightField(
    Mode=_1,
    ProfileCurve=geo_3,
    MinimumHeight=Slider(0.2, range=0..1),
    RangeMax=Slider(0.7, range=0..10),
    TargetHeight=0.4,
    BeadWidth=0.8,
    MinimumOverlap=0.25,
    NormalizeRange=Toggle(False))
fdm_vase_2 = FDMVaseModeGenerator(Geometry=revsrf, LayerHeight=1, LayerHeightField=lh_field, ExtrusionWidth=1.5, Options=vase_options_2)  # -> Toolpath, HelixCurve, UnsampledCurve, TopCurves, BottomCurves

fdm_toolpath_3 = FDMToolpath(Curve=fdm_vase_2.HelixCurve, EWidth=Slider(2, range=0..10))

# ----
# variable layer height and shifted postions
# by defining the positions (0..1) of the
# supplied layerheights it is possible to shift
# areas up and down
number_slider_4 = Slider(0.6912, range=0.2..0.9)
_1_2 = Number(1)
_0 = Number(0)
merge_6 = Merge(Data1=_0, Data2=number_slider_4, Data3=_1_2)
_0_2 = Mode(0)
panel = Panel("""1.7
0.5
1.7""")
geo_4 = Geometry(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)
number_3 = Number(0.3)

lh_field_2 = FDMLayerHeightField(
    Mode=_0_2,
    Heights=panel,
    Positions=merge_6,
    MinimumHeight=0.1,
    RangeMax=0.4,
    TargetHeight=0.4,
    BeadWidth=0.8,
    MinimumOverlap=0.25,
    NormalizeRange=False)
vase_options_4 = FDMVaseOptions(BaseThickness=number_3)
fdm_vase_3 = FDMVaseModeGenerator(Geometry=geo_4, LayerHeight=1, LayerHeightField=lh_field_2, ExtrusionWidth=1.5, Options=vase_options_4)  # -> Toolpath, HelixCurve, UnsampledCurve, TopCurves, BottomCurves

fdm_toolpath_4 = FDMToolpath(Curve=fdm_vase_3.HelixCurve, EWidth=Slider(2, range=0..10))

# ----
# input should be a closed planar polyling
# output is a series of inner offsets
# first offset is 0.5*linewidth
# subsequent are n*linewidth
# infill curve is the inner most wall;
# area to be filled with infill
number_slider_5 = Slider(2, range=0..10)
# wall generation (different widths)
number_slider_6 = Slider(4, range=0..10)
# TOOLPATHS
# developed by JÜNGERKÜHN
# contact: toolpaths@juengerkuehn.com
# juengerkuehn.com
# github.com/KonradJuenger/TOOLPATHS
# wall generation
geo_5 = Geometry(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)

fdm_walls_2 = FDMWallsGenerator(Curves=geo_5, LineWidth=number_slider_5, Count=number_slider_6, WallType=list)  # -> Curves, InfillCurves

geo_6 = Geometry(fdm_walls_2.Curves)
geo_7 = Geometry(fdm_walls_2.InfillCurves)
fdm_toolpath_5 = FDMToolpath(Curve=geo_6, EWidth=number_slider_5)

# ----
# manual offsets can be used to create walls with different thicknesses
# (right click to reveal the input)
# to get the offsets from linewidths:
# (Sum of all previous linewidths) + (Half of current linewidth)
linewidths = Panel("""1
2
1
1.5
2""")
geo_8 = Geometry(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)

ma = MassAddition(Input=linewidths)  # -> Result, PartialResults
_0_3 = Integer(0)
_2_5 = Integer(2)
division = Division(A=linewidths, B=_2_5)
ins = InsertItems(List=ma.PartialResults, Item=_0_3, Indices=_0_3, Wrap=True)
addition = Addition(A=ins, B=division)
short = ShortestList(ListA=addition, ListB=division, TrimMode=2)  # -> ListA, ListB

neg = Negative(Value=short.ListA)
fdm_walls_3 = FDMWallsGenerator(Curves=geo_8, LineWidth=1, Count=1, WallType=list_7, ManualOffsets=neg)  # -> Curves, InfillCurves

fdm_toolpath_6 = FDMToolpath(Curve=fdm_walls_3.Curves, EWidth=linewidths)

# ----
# variable layer heigh based on explicit values
# define a sequence of layerheights to interpolate
panel_2 = Panel("""1.7
0.3
1.7
0.3
1.7
0.3""")
_0_4 = Mode(0)
geo_9 = Geometry(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)

lh_field_3 = FDMLayerHeightField(
    Mode=_0_4,
    Heights=panel_2,
    MinimumHeight=0.1,
    RangeMax=0.4,
    TargetHeight=0.4,
    BeadWidth=0.8,
    MinimumOverlap=0.25,
    NormalizeRange=False)
fdm_vase_4 = FDMVaseModeGenerator(Geometry=geo_9, LayerHeight=1, LayerHeightField=lh_field_3, ExtrusionWidth=1.5, Options=vase_options)  # -> Toolpath, HelixCurve, UnsampledCurve, TopCurves, BottomCurves

fdm_toolpath_7 = FDMToolpath(Curve=fdm_vase_4.HelixCurve, EWidth=Slider(2, range=0..10))

# ----
# basic planar slicing
# create infill curves
# converting to a mesh
# results in faster slicing
input_geo = Geometry(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)
number_slider_7 = Slider(2, range=0..10)
vec = Vector(Vector(9.385319152, 10.3421104, 0))

mesh = Mesh(input_geo)
planar_slice = FDMPlanarSliceGenerator(Geometry=mesh, LayerHeight=1, ExtrusionWidth=number_slider_7)  # -> Toolpaths, SliceCurves
fdm_walls_4 = FDMWallsGenerator(Curves=planar_slice.SliceCurves, LineWidth=number_slider_7, Count=Slider(2, range=0..10), WallType=list_2)  # -> Curves, InfillCurves

fdm_infill_3 = FDMInfillGenerator(InfillCurves=fdm_walls_4.InfillCurves, Direction=vec, InfillSpacing=2, MinLength=0, InfillType=list_4)
merge_7 = Merge(Data1=fdm_walls_4.Curves, Data2=fdm_infill_3)
# create toolpath object
fdm_toolpath_8 = FDMToolpath(Curve=merge_7, EWidth=Slider(2, range=0..10))

curve_gen = Merge(
    Data1=flatten(fdm_toolpath_5),
    Data2=flatten(fdm_toolpath_6),
    Data3=flatten(fdm_toolpath),
    Data4=flatten(fdm_toolpath_8),
    Data5=flatten(merge_5),
    Data6=flatten(fdm_toolpath_3),
    Data7=flatten(fdm_toolpath_7),
    Data8=flatten(fdm_toolpath_4))

_0_5 = Integer(0)
# define machine
extruder = FDMExtruder(
    ExtruderNumber=_0_5,
    NozzleDiameter=Slider(0.8, range=0..10),
    FilamentDiameter=Slider(1.75, range=0..10),
    PrintMaterial=ColourSwatch(SwatchColor=RGB(74, 158, 247)))
_1_3 = Integer(1)
extruder_2 = FDMExtruder(ExtruderNumber=_1_3, NozzleDiameter=0.8, FilamentDiameter=1.75, PrintMaterial=ColourSwatch(SwatchColor=RGB(247, 74, 74)))

merge_8 = Merge(Data1=extruder, Data2=extruder_2)

machine = FDMMachine(G0RapidSpeed=200, MaxZSpeed=6, Extruders=merge_8, EPosAbsRel=0, HomeBeforePrint=False, CenterPrintXY=Toggle(False))

# ----
# central program generator
processor = FDMProcessor(Toolpaths=curve_gen, Machine=machine, Defaults=defaults, ProcessorMode=mode)  # -> SimulationData, Errors, Warnings
errors = Panel(processor.Errors)
warnings = Panel(processor.Warnings)

# ----
# set a directory not file
machine_2 = Machine({"Klipper": "klipper", "Klipper (No Z)": "klipper_noz", "RepRap": "reprap", "Prusa": "prusa", "Bambu": "bambu"}, selected="Klipper")
# output the gcode
# by defining the positions (0..1) of the
# supplied layerheights it is possible to shift
# areas up and down
fdm_g_code = FDMGCodeOutput(
    SimulationData=processor.SimulationData,
    MachineType=machine_2,
    OutputDirectory=path,
    Save=False,
    Upload=False,
    StartPrint=False,
    OutputGCode=False)  # -> GCode, Toolpath, Info, VerboseDebug, ToolpathDebug

# ----
# display the simulation
fdm_sim = FDMSimulator(
    SimulationData=processor.SimulationData,
    Time=1,
    Play=False,
    Speed=1,
    StadiumSegments=3,
    BakeMeshes=False,
    ProgressOverlay=True,
    DisablePreview=False)  # -> CurrentTime, Meshes, ToolPosition, ProgramDuration
