# Grasshopper definition toolpaths_inheritance.gh (Grasshopper 1.0.8)
# plug-ins: Toolpaths.Fdm

geo = Geometry(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)
fdm_toolpath = FDMToolpath(Curve=geo, ZHop=Slider(1.2, range=0..5))

geo_2 = Geometry(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)
fdm_toolpath_2 = FDMToolpath(Curve=geo_2, ZHop=Slider(4.1, range=0..5))

geo_3 = Geometry(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)
fdm_toolpath_3 = FDMToolpath(Curve=geo_3, ZHop=Slider(0.6, range=0..5))

geo_4 = Geometry(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)
fdm_toolpath_4 = FDMToolpath(Curve=geo_4, ZHop=Slider(4.9, range=0..5))

# ----
# in this example the zHop will be 2mm as it falls back to the value specified in the default component
geo_5 = Geometry(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)
fdm_toolpath_5 = FDMToolpath(Curve=geo_5)  # -> flatten(Toolpath)

# ----
# TOOLPATHS
# developed by JÜNGERKÜHN
# contact: toolpaths@juengerkuehn.com
# juengerkuehn.com
# github.com/KonradJuenger/TOOLPATHS
# SETTINGS HIERARCHY
# Settings follow a simple hierachy
# Global Defaults (lowest) → Linked Template → Local Override (highest).
#  You can use any existing toolpath as a template for a new one,
# inheriting all properties automatically and overriding only what is necessary.
# properties at the default level are used as a fallback.
# if no other setting is applied the default value is used.
number_slider = Slider(0.5, range=0..1)
defaults = FDMDefaults(
    HeightfieldResolution=number_slider,
    SafeClearance=Slider(6, range=0..10),
    ZHopHeight=Slider(2, range=0..10),
    MeshingResolution=Slider(0.5, range=0..1),
    SmoothingWindow=Slider(1, range=0..100),
    DegenerateAspectRatio=Slider(6.123, range=0..10),
    MaxLayerHeight=Slider(3.072, range=0..10))

# ----
# in this example the zhop will be 3.2mm as last applied setting overwrites all other settings
# Toolpaths can inherit all settings from a template toolpath via the Toolpath input.
# properties can be set on a per toolpath level
# Local settings on the toolpath override both inherited
# properties and global defaults.
# properties set at toolpath level overwrite
# defaults
relay = Relay([fdm_toolpath, fdm_toolpath_2])
fdm_toolpath_6 = FDMToolpath(Toolpath=relay, ZHop=Slider(3.2, range=0..5))

# ----
# in this example the zhop will be 0.6mm for the first toolpath and 4.9mm for the second
# as the child toolpath does not specify
#  a new zhop value all  input toolpath preserve their value
relay_2 = Relay([fdm_toolpath_3, fdm_toolpath_4])

# ----
# in this case the zhop stays the same but
# speed is set to 2 for both toolpaths
number_slider_2 = Slider(2, range=0..10)
fdm_toolpath_7 = FDMToolpath(Toolpath=relay_2, Speed=number_slider_2)
merge = Merge(Data1=flatten(fdm_toolpath_6), Data2=flatten(fdm_toolpath_7), Data3=flatten(fdm_toolpath_5))
mode = ProcessorMode({"Hybrid": 2, "Preview": 1, "Simulation": 0}, selected="Hybrid")
path = FilePath()

_0 = Integer(0)
# define machine
extruder = FDMExtruder(
    ExtruderNumber=_0,
    NozzleDiameter=Slider(0.8, range=0..10),
    FilamentDiameter=Slider(1.75, range=0..10),
    PrintMaterial=ColourSwatch(SwatchColor=RGB(74, 158, 247)))
_1 = Integer(1)
extruder_2 = FDMExtruder(ExtruderNumber=_1, NozzleDiameter=0.8, FilamentDiameter=1.75, PrintMaterial=ColourSwatch(SwatchColor=RGB(247, 74, 74)))

merge_2 = Merge(Data1=extruder, Data2=extruder_2)

machine = FDMMachine(G0RapidSpeed=200, MaxZSpeed=6, Extruders=merge_2, EPosAbsRel=0, HomeBeforePrint=False, CenterPrintXY=Toggle(False))

# ----
# central program generator
processor = FDMProcessor(Toolpaths=merge, Machine=machine, Defaults=defaults, ProcessorMode=mode)  # -> SimulationData, Errors, Warnings
errors = Panel(processor.Errors)
warnings = Panel(processor.Warnings)

# ----
# set a directory not file
machine_2 = Machine({"Klipper": "klipper", "Klipper (No Z)": "klipper_noz", "RepRap": "reprap", "Prusa": "prusa", "Bambu": "bambu"}, selected="Klipper")
# output the gcode
# by defining the positions (0..1) of the
# supplied layerheights it is possible to shift
# areas up and down
fdm_g_code = FDMGCodeOutput(
    SimulationData=processor.SimulationData,
    MachineType=machine_2,
    OutputDirectory=path,
    Save=False,
    Upload=False,
    StartPrint=False,
    OutputGCode=False)  # -> GCode, Toolpath, Info, VerboseDebug, ToolpathDebug

# ----
# display the simulation
fdm_sim = FDMSimulator(
    SimulationData=processor.SimulationData,
    Time=1,
    Play=False,
    Speed=1,
    StadiumSegments=3,
    BakeMeshes=False,
    ProgressOverlay=True,
    DisablePreview=False)  # -> CurrentTime, Meshes, ToolPosition, ProgramDuration
