# Grasshopper definition toolpaths_modulators.gh (Grasshopper 1.0.8)
# plug-ins: Toolpaths.Fdm, Toolpaths.Gh

# ----
# the flow modulator can be used to varie the flow of material along the path
number_slider = Slider(1, range=0..10)
# TOOLPATHS
# developed by JÜNGERKÜHN
# contact: toolpaths@juengerkuehn.com
# juengerkuehn.com
# github.com/KonradJuenger/TOOLPATHS
# Modulators control properties of a toolpath along its length, segment by segment.
# Flow Modulator
geo = Geometry(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)
# MODULATORS
fdm_toolpath = FDMToolpath(Curve=geo, Volume=number_slider)
panel = Panel("""1
3
1
3
1
3
1""")

mode = Mode({"Angle": 0, "Length": 1}, selected="Angle")
_2 = Integer(2)

# ----
# Subdivide  + Normal Displacement
# subdivide modulator adds more segments to the path
geo_2 = Geometry(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)
fdm_toolpath_2 = FDMToolpath(Curve=geo_2, EWidth=_2)
mod_subdivide = ModulatorSubdivide(
    Input=fdm_toolpath_2,
    SegmentLength=0,
    DivisionsPerSegment=Slider(11, range=3..15),
    RemapMode=2,
    RespectClosed=True,
    SubdividePolylines=False)
panel_2 = Panel("""-1
-1
1
1""")
# normal displacement moves the control points
#  normal to the path direction in a selected plane (xy)
multiplication = Multiplication(A=panel_2, B=Slider(5, range=0..10))
mod_ndisp = ModulatorNormalDisplacement(Input=mod_subdivide, Distances=multiplication, VertexMappingStrategy=2, Mode=0)

mod_flow = ModulatorFlow(Input=fdm_toolpath, Scales=panel, VertexMappingStrategy=2)
_2_2 = Integer(2)
_20 = Integer(20)

# ----
# Vector Field
geo_3 = Geometry(Point(161.3971625, 169.3052497, 0))
cir = Circle(Plane=geo_3, Radius=10)
curvedivide = CurveDivider(Curves=cir, SegmentLength=2, SubdividePolylines=False)
fdm_toolpath_3 = FDMToolpath(Curve=curvedivide, EWidth=_2_2)
Z = UnitZ(Factor=1)
arrlinear = LinearArray(Geometry=fdm_toolpath_3, Direction=Z, Count=_20)  # -> Geometry, Transform
vec = Vector([Vector(1, 0, 0), Vector(0, 1, 0), Vector(0, 0, 0), Vector(-0.6253084452, -0.780377696, 0)])
# the vector field modulator displaces
# the toolpaths in a smooth vector field.
geo_4 = Geometry([Point(101.292012, 167.1058707, 13.25753348), Point(163.9638994, 158.2793554, 13.25753348), Point(161.3971625, 169.3052497, 0), Point(158.4955606, 162.9774588, 9.426950082)])
mod_intervecfield = ModulatorInterpolatedVectorField(Input=arrlinear.Geometry, Points=geo_4, Vectors=vec, Sigma=Slider(9.5, range=0..10), Strength=Slider(8, range=0..100))

# ----
# The FDM Processor uses these
#  values as defaults when they are
# not set on the Toolpath object.
number_slider_2 = Slider(60, range=0..100)
# define process defaults
number_slider_3 = Slider(72, range=0..100)
defaults = FDMDefaults(Speed=number_slider_3, ExtruderTemperature=Slider(200, range=0..1000), BedTemperature=number_slider_2)

mode_2 = ProcessorMode({"Hybrid": 2, "Preview": 1, "Simulation": 0}, selected="Hybrid")
path = FilePath()

# ----
# the path has 7 segments
# array mutiplies the toolpath 5 times
# as there are 7 segments and only 2 values
# the modulator has to map the values
# somehow to the segments.
# the options are:
# 0 constant -> 1 1 1 1 1 1 1
# 2 wrap -> 131313131
# 3 repeat last -> 1333333
# 4 normalized -> 1111333
# 5 interpolated -> 1 1.3 1.7 2 2.3 2.7 3
number_slider_4 = Slider(1, range=0..10)
geo_5 = Geometry(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)
# Vertex Mapping
explode = Explode(Curve=geo_5, Recursive=True)  # -> Segments, Vertices
lng = ListLength(List=explode.Segments)
fdm_toolpath_4 = FDMToolpath(Curve=geo_5, Volume=number_slider_4)
panel_3 = Panel(lng)
panel_4 = Panel("""0
2
3
4
5""")
# the modulator maps the supplied flow values
# (1 and 3)  to the segments of the toolpath
panel_5 = Panel("""1
3""")

Y = UnitY(Factor=4.808)
arrlinear_2 = LinearArray(Geometry=fdm_toolpath_4, Direction=Y, Count=5)  # -> Geometry, Transform

mod_flow_2 = ModulatorFlow(Input=arrlinear_2.Geometry, Scales=panel_5, VertexMappingStrategy=panel_4)

# ----
# Normal Displacement 3D
geo_6 = Geometry(Point(124.3394153, 170.2310199, 0))
_10 = Number(10)
_18 = Number(18)
cyl = Cylinder(Base=geo_6, Radius=_10, Length=_18)
panel_6 = Panel("""-1
-1
1
1""")
multiplication_2 = Multiplication(A=panel_6, B=Slider(0.55, range=0..1))

vase_options = FDMVaseOptions(SamplingMode=mode, Divisions=Slider(46, range=0..100), BaseThickness=Slider(0.3, range=0..1))
fdm_vase = FDMVaseModeGenerator(Geometry=cyl, LayerHeight=1, ExtrusionWidth=Slider(1.65, range=0..3), Options=vase_options)  # -> Toolpath, HelixCurve, UnsampledCurve, TopCurves, BottomCurves

mod_ndisp_2 = ModulatorNormalDisplacement(Input=fdm_vase.Toolpath, Distances=multiplication_2, VertexMappingStrategy=2, Mode=0)

merge = Merge(Data1=flatten(mod_ndisp), Data2=flatten(mod_ndisp_2), Data3=flatten(mod_intervecfield))
merge_2 = Merge(Data1=flatten(mod_flow), Data2=flatten(mod_flow_2), Data3=flatten(merge))

_0 = Integer(0)
# define machine
extruder = FDMExtruder(
    ExtruderNumber=_0,
    NozzleDiameter=Slider(0.8, range=0..10),
    FilamentDiameter=Slider(1.75, range=0..10),
    PrintMaterial=ColourSwatch(SwatchColor=RGB(74, 158, 247)))
_1 = Integer(1)
extruder_2 = FDMExtruder(ExtruderNumber=_1, NozzleDiameter=0.8, FilamentDiameter=1.75, PrintMaterial=ColourSwatch(SwatchColor=RGB(247, 74, 74)))

merge_3 = Merge(Data1=extruder, Data2=extruder_2)

machine = FDMMachine(G0RapidSpeed=200, MaxZSpeed=6, Extruders=merge_3, EPosAbsRel=0, HomeBeforePrint=False, CenterPrintXY=Toggle(False))

# ----
# central program generator
processor = FDMProcessor(Toolpaths=merge_2, Machine=machine, Defaults=defaults, ProcessorMode=mode_2)  # -> SimulationData, Errors, Warnings
errors = Panel(processor.Errors)
warnings = Panel(processor.Warnings)

# ----
# set a directory not file
machine_2 = Machine({"Klipper": "klipper", "Klipper (No Z)": "klipper_noz", "RepRap": "reprap", "Prusa": "prusa", "Bambu": "bambu"}, selected="Klipper")
# output the gcode
# by defining the positions (0..1) of the
# supplied layerheights it is possible to shift
# areas up and down
fdm_g_code = FDMGCodeOutput(
    SimulationData=processor.SimulationData,
    MachineType=machine_2,
    OutputDirectory=path,
    Save=False,
    Upload=False,
    StartPrint=False,
    OutputGCode=False)  # -> GCode, Toolpath, Info, VerboseDebug, ToolpathDebug

# ----
# display the simulation
fdm_sim = FDMSimulator(
    SimulationData=processor.SimulationData,
    Time=1,
    Play=False,
    Speed=1,
    StadiumSegments=3,
    BakeMeshes=False,
    ProgressOverlay=True,
    DisablePreview=False)  # -> CurrentTime, Meshes, ToolPosition, ProgramDuration
