# Grasshopper definition toolpaths_quickstart.gh (Grasshopper 1.0.8)
# plug-ins: Toolpaths.Fdm

_1 = Integer(1)
extruder = FDMExtruder(
    ExtruderNumber=_1,
    NozzleDiameter=Slider(0.8, range=0..10),
    FilamentDiameter=Slider(1.75, range=0..10),
    PrintMaterial=ColourSwatch(SwatchColor=RGB(74, 158, 247)))
box = Box({Plane=PlaneXY(0, 0, 0), X=Domain(0, 200), Y=Domain(0, 200), Z=Domain(0, 200)})
machine = FDMMachine(
    G0RapidSpeed=200,
    MaxZSpeed=6,
    MachineBounds=box,
    Extruders=extruder,
    EPosAbsRel=0,
    HomeBeforePrint=False,
    CenterPrintXY=Toggle(False))

# ----
# The FDM Processor uses these
#  values as defaults when they are
# not set on the Toolpath object.
number_slider = Slider(60, range=0..100)
# define process defaults
number_slider_2 = Slider(72, range=0..100)
defaults = FDMDefaults(Speed=number_slider_2, ExtruderTemperature=Slider(200, range=0..1000), BedTemperature=number_slider)

# ----
# define machine
number_slider_3 = Slider(1.6, range=0..10)
# TOOLPATHS
# developed by JÜNGERKÜHN
# contact: toolpaths@juengerkuehn.com
# juengerkuehn.com
# github.com/KonradJuenger/TOOLPATHS
# create toolpath
geo = Geometry(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)
fdm_toolpath = FDMToolpath(Curve=geo, Volume=number_slider_3)

mode = ProcessorMode({"Hybrid": 2, "Preview": 1, "Simulation": 0}, selected="Hybrid")
# central processor
processor = FDMProcessor(Toolpaths=fdm_toolpath, Machine=machine, Defaults=defaults, ProcessorMode=mode)  # -> SimulationData, Errors, Warnings
errors = Panel(processor.Errors)
warnings = Panel(processor.Warnings)
path = FilePath()

# ----
# set a directory not file
machine_2 = Machine({"Klipper": "klipper", "Klipper (No Z)": "klipper_noz", "RepRap": "reprap", "Prusa": "prusa", "Bambu": "bambu"}, selected="Klipper")
# output the gcode
fdm_g_code = FDMGCodeOutput(
    SimulationData=processor.SimulationData,
    MachineType=machine_2,
    OutputDirectory=path,
    Save=False,
    Upload=False,
    StartPrint=False,
    OutputGCode=False)  # -> GCode, Toolpath, Info, VerboseDebug, ToolpathDebug

# ----
# display the simulation
fdm_sim = FDMSimulator(
    SimulationData=processor.SimulationData,
    Time=1,
    Play=False,
    Speed=1,
    StadiumSegments=3,
    BakeMeshes=False,
    ProgressOverlay=True,
    DisablePreview=False)  # -> CurrentTime, Meshes, ToolPosition, ProgramDuration
