# Grasshopper definition toolpaths_vasemode.gh (Grasshopper 1.0.8)
# plug-ins: Toolpaths.Fdm, Toolpaths.Gh

# ----
# smooth out the path at the top
smooth_top = BooleanToggle(True)
# prevent layerheigth 0
# at the start of vasemode
vase_mode_start_lh = Slider(0.1, range=0..1)
# main settings
layerheight = Slider(0.6, range=0..10)
width = Slider(0.877, range=0..10)
# number of solid layers
base_layers = Slider(3, range=0..10)

# ----
# TOOLPATHS
# developed by JÜNGERKÜHN
# contact: toolpaths@juengerkuehn.com
# juengerkuehn.com
# github.com/KonradJuenger/TOOLPATHS
# solid bottom layers
# input geometry
number_slider = Slider(20, range=0..100)
cyl = Cylinder(Base=PlaneXY(94.70520985, 24.6220849, 0), Radius=number_slider, Length=Slider(29, range=0..100))

# ----
# staggered surface pattern
# input geometry
xy = XYPlane(Origin=Point(166.4064589, 29.26640464, 0))

# ----
# smooth out the path at the top
smooth_top_2 = BooleanToggle(True)
# prevent layerheigth 0
# at the start of vasemode
vase_mode_start_lh_2 = Slider(0.1, range=0..1)
# main settings
layerheight_2 = Slider(0.6, range=0..10)
# number of solid layers
width_2 = Slider(0.877, range=0..10)

cyl_2 = Cylinder(Base=xy, Radius=Slider(17, range=0..100), Length=Slider(29, range=0..100))

# ----
# angle is length independent
# number of division per layer
# offset beteen layers
# pattern
# strength
number_slider_2 = Slider(2, range=0..10)
mode = Mode({"Angle": 0, "Length": 1}, selected="Angle")
panel = Panel("""-1
1
1
-1""")

multiplication = Multiplication(A=layerheight, B=base_layers)
layerheight_3 = Number(layerheight)
width_3 = Number(width)
addition = Addition(A=multiplication, B=vase_mode_start_lh)
layerheight_4 = Number(layerheight_2)
width_4 = Number(width_2)
vase_options = FDMVaseOptions(BaseThickness=addition, FadeStartHeight=vase_mode_start_lh, SmoothEnd=smooth_top)
fdm_vase = FDMVaseModeGenerator(Geometry=cyl, LayerHeight=layerheight_3, ExtrusionWidth=width_3, Options=vase_options)  # -> Toolpath, HelixCurve, UnsampledCurve, TopCurves, BottomCurves
vase_options_2 = FDMVaseOptions(
    SamplingMode=mode,
    Divisions=Slider(38, range=0..100),
    StaggerCycle=number_slider_2,
    FadeStartHeight=vase_mode_start_lh_2,
    SmoothEnd=smooth_top_2)

# ----
# base outputs planar curves for solid infill layers
# Use an offset of 0, since the default is 0.5 × width.
# Vase mode uses the path as the wall centerline.
number_slider_3 = Slider(0, range=0..0.01)
list = ValueList({"Offset": 0, "Spiral": 1}, selected="Offset")
# walls for solid bottom
width_5 = Number(width_3)
fdm_walls = FDMWallsGenerator(Curves=fdm_vase.BottomCurves, LineWidth=width_5, Count=1, WallType=list, ManualOffsets=number_slider_3)  # -> Curves, InfillCurves

fdm_vase_2 = FDMVaseModeGenerator(Geometry=cyl_2, LayerHeight=layerheight_4, ExtrusionWidth=width_4, Options=vase_options_2)  # -> Toolpath, HelixCurve, UnsampledCurve, TopCurves, BottomCurves

# ----
# alternate infill direction
X = UnitX(Factor=1)
Y = UnitY(Factor=1)
# infill for solid bottom
long = LongestList(ListA=flatten(fdm_walls.InfillCurves), ListB=[Y, X], PaddingMode=4)  # -> ListA, graft(ListB)

width_6 = Number(width_3)

list_2 = ValueList({"Monotonic": 0, "Monotonic (Connected)": 1, "Gyroid": 2, "Gyroid (Connected)": 3, "Spiral": 4}, selected="Monotonic (Connected)")
fdm_infill = FDMInfillGenerator(InfillCurves=fdm_walls.InfillCurves, Direction=long.ListB, InfillSpacing=width_6, MinLength=0, InfillType=list_2)

lng = ListLength(List=panel)
mod_subdivide = ModulatorSubdivide(
    Input=fdm_vase_2.Toolpath,
    SegmentLength=0,
    DivisionsPerSegment=lng,
    RemapMode=2,
    RespectClosed=True,
    SubdividePolylines=False)
merge = Merge(Data1=fdm_walls.Curves, Data2=fdm_infill)
# additional print settings for vase toolpath
# we use the ready-made toolpath
# that vasemode provides but we
# want to set the speed, for this we
# route the toolpath object into a new
# toolpath ( right click toolpath input)
number_slider_4 = Slider(100, range=0..100)
multiplication_2 = Multiplication(A=panel, B=Slider(1.33, range=0..5))
mod_ndisp = ModulatorNormalDisplacement(Input=mod_subdivide, Distances=multiplication_2, VertexMapping=2, Mode=1)

# ----
# print settings for solid bottom
e_mode = EMode({"Volume": 0, "Auto Width": 1, "Auto Ratio": 2, "Static": 3, "No Extrusion": 4}, selected="Volume")
layerheight_5 = Number(layerheight_3)
width_7 = Number(width_3)
extrvolume = FDMExtrusionVolume(Width=width_7, Height=layerheight_5)
fdm_toolpath = FDMToolpath(Curve=merge, EMode=e_mode, Volume=extrvolume, Speed=Slider(20, range=0..100))

fdm_toolpath_2 = FDMToolpath(Toolpath=fdm_vase.Toolpath, Speed=number_slider_4)
merge_2 = Merge(Data1=fdm_toolpath_2, Data2=flatten(fdm_toolpath))
merge_3 = Merge(Data1=merge_2, Data2=mod_ndisp)

# ----
# extruder
_0 = ExtruderNumber(0)
nozzle_diameter = NozzleDiameter(0.8)
filament_diameter = FilamentDiameter(1.75)
extruder = FDMExtruder(ExtruderNumber=_0, NozzleDiameter=nozzle_diameter, FilamentDiameter=filament_diameter, PrintMaterial=RGB(100, 149, 237))

# ----
# end gcode for 3d printer
# simualtion is based on a heightfield, higher res creates more samples
# Z values for first move, to prevent collisions
# extrusion width is smoothed per default with moving average
panel_2 = Panel("""M104 S0; extruder OFF
M140 S0 ;Bed OFF
G91 ;relative positioning
G1 E-1 F300  ;retract filament
G1 Z+0.5 E-2 F1500 ;move up
G90  ;absolute positioning
M84 ; stepper motors off
M107 ; fan off""")
center = BooleanToggle(False)
home = BooleanToggle(True)
box = Box({Plane=Plane(origin=(0, 300, 0), x=(1, 0, 0), y=(0, -1, 0)), X=Domain(0, 300), Y=Domain(0, 300), Z=Domain(-400, 0)})

# ----
# values are specific for printer
number_slider_5 = Slider(0.3, range=0..1)
# global Z hop
number_slider_6 = Slider(0.4, range=0..1)
# resolution of the simulation mesh
number_slider_7 = Slider(0.4, range=0..1)
# retraction of the filament after each extrusion
number_slider_8 = Slider(0.7, range=0..1)
# extrusion aspect ratio limiter
number_slider_9 = Slider(10, range=0..10)
# clamp extrusion height for simulation
number_slider_10 = Slider(0.8, range=0..10)
defaults = FDMDefaults(
    HeightfieldResolution=number_slider_5,
    SafeClearance=Slider(6, range=0..10),
    ZHopHeight=number_slider_6,
    Speed=Slider(60, range=0..100),
    ExtruderTemperature=Slider(208, range=0..1000),
    BedTemperature=Slider(66, range=0..100),
    MeshingResolution=number_slider_7,
    SmoothingWindow=Slider(1, range=0..100),
    Retraction=number_slider_8,
    RetractionSpeed=Slider(12, range=0..100),
    DegenerateAspectRatio=number_slider_9,
    MaxLayerHeight=number_slider_10)

# ----
# FDM Machine
machine = FDMMachine(
    G0RapidSpeed=Slider(160, range=0..1000),
    MaxZSpeed=Slider(10, range=0..10),
    MachineBounds=box,
    Extruders=extruder,
    EndGCode=panel_2,
    EPosAbsRel=Slider(1, range=0..1),
    HomeBeforePrint=home,
    CenterPrintXY=center)
mode_2 = ProcessorMode({"Hybrid": 2, "Preview": 1, "Simulation": 0}, selected="Hybrid")
# central program generator
processor = FDMProcessor(Toolpaths=merge_3, Machine=machine, Defaults=defaults, ProcessorMode=mode_2)  # -> SimulationData, Errors, Warnings
errors = Panel(processor.Errors)
warnings = Panel(processor.Warnings)
path = FilePath()

# ----
# set a directory not file
machine_2 = Machine({"Klipper": "klipper", "Klipper (No Z)": "klipper_noz", "RepRap": "reprap", "Prusa": "prusa", "Bambu": "bambu"}, selected="Klipper")
# output the gcode
fdm_g_code = FDMGCodeOutput(
    SimulationData=processor.SimulationData,
    MachineType=machine_2,
    OutputDirectory=path,
    Save=False,
    Upload=False,
    StartPrint=False,
    OutputGCode=False)  # -> GCode, Toolpath, Info, VerboseDebug, ToolpathDebug

play = BooleanToggle(False)
mesh_output = BooleanToggle(False)
progress_bar = BooleanToggle(True)
hide = BooleanToggle(False)
# display the simulation
number_slider_11 = Slider(1, range=0..1)
fdm_sim = FDMSimulator(
    SimulationData=processor.SimulationData,
    Time=number_slider_11,
    Play=play,
    Speed=Slider(4, range=0..10),
    StadiumSegments=Slider(3, range=0..10),
    BakeMeshes=mesh_output,
    ProgressOverlay=progress_bar,
    DisablePreview=hide)  # -> CurrentTime, Meshes, ToolPosition, ProgramDuration
