# Grasshopper definition bench.gh (Grasshopper 1.0.8)
# plug-ins: Toolpaths.Fdm, Toolpaths.Gh

# ----
# infer axis needs to be true
# as the inputgeomtry is not on a
# single vertical axis
number_slider = Slider(3, range=0..10)
mode = Mode({"Angle": 0, "Length": 1}, selected="Length")

# ----
# alternatively suppy a manual center curve
number_slider_2 = Slider(0.1, range=0..1)

# ----
# TOOLPATHS
# developed by JÜNGERKÜHN
# contact: toolpaths@juengerkuehn.com
# juengerkuehn.com
# github.com/KonradJuenger/TOOLPATHS
# input geometry
geo = Geometry([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])
loft = Loft(Curves=geo, Options={Adjust=False, Closed=False, LoftEnds=0, LoftSimp=0, LoftType=1, Rebuild=10, Refit=0.01})

infer_axis = BooleanToggle(True)
fdm_vase_options = FDMVaseOptions(
    SamplingMode=mode,
    SamplingDistance=number_slider,
    InferAxis=infer_axis,
    TrimBelowHeight=number_slider_2,
    FadeStart=Toggle(True),
    SmoothEnd=Toggle(True))
fdm_vase = FDMVaseModeGenerator(Geometry=loft, LayerHeight=Slider(1, range=0..10), ExtrusionWidth=1.5, Options=fdm_vase_options)  # -> Toolpath, HelixCurve, UnsampledCurve, TopCurves, BottomCurves
geo_2 = Geometry()

# ----
# we subdivide the toolpath
# by the length of the pattern
pattern = Panel("""-1
1
1
-1""")
lng = ListLength(List=pattern)
mod_subdivide = ModulatorSubdivide(
    Input=fdm_vase.Toolpath,
    SegmentLength=0,
    DivisionsPerSegment=lng,
    RemapMode=2,
    RespectClosed=True,
    SubdividePolylines=False)

# ----
# pattern strengh
number_slider_3 = Slider(1.33, range=0..5)
multiplication = Multiplication(A=pattern, B=number_slider_3)

# ----
# as we supply multiple regions for the mask,
# component needs to know how to handle them
#  ( boolean logic)
# 
# alternatively mesh the mask input geometry and join the meshes into one ( its faster as well)
number_slider_4 = Slider(1, range=0..10)

geo_3 = Geometry([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])

# ----
# we mask the first couple of
# layers to have no pattern applied
maskregion = MaskFromRegion(
    Input=mod_subdivide,
    RegionGeometry=geo_3,
    Invert=Toggle(True),
    Falloff=0,
    CombinationMode=number_slider_4,
    CombinationModeEnabled=True,
    FalloffModeEnabled=False)

# ----
# apply pattern
mod_ndisp = ModulatorNormalDisplacement(Input=mod_subdivide, Distances=multiplication, VertexMapping=2, Mode=maskregion)

# ----
# extruder
_0 = ExtruderNumber(0)
nozzle_diameter = NozzleDiameter(0.8)
filament_diameter = FilamentDiameter(1.75)
extruder = FDMExtruder(ExtruderNumber=_0, NozzleDiameter=nozzle_diameter, FilamentDiameter=filament_diameter, PrintMaterial=RGB(100, 149, 237))

# ----
# end gcode for 3d printer
# simualtion is based on a heightfield, higher res creates more samples
# Z values for first move, to prevent collisions
# extrusion width is smoothed per default with moving average
panel = Panel("""M104 S0; extruder OFF
M140 S0 ;Bed OFF
G91 ;relative positioning
G1 E-1 F300  ;retract filament
G1 Z+0.5 E-2 F1500 ;move up
G90  ;absolute positioning
M84 ; stepper motors off
M107 ; fan off""")
center = BooleanToggle(False)
home = BooleanToggle(True)
box = Box({Plane=Plane(origin=(0, 300, 0), x=(1, 0, 0), y=(0, -1, 0)), X=Domain(0, 300), Y=Domain(0, 300), Z=Domain(-400, 0)})

# ----
# values are specific for printer
number_slider_5 = Slider(0.3, range=0..1)
# global Z hop
number_slider_6 = Slider(0.4, range=0..1)
# resolution of the simulation mesh
number_slider_7 = Slider(0.4, range=0..1)
# retraction of the filament after each extrusion
number_slider_8 = Slider(0.7, range=0..1)
# extrusion aspect ratio limiter
number_slider_9 = Slider(10, range=0..10)
defaults = FDMDefaults(
    HeightfieldResolution=number_slider_5,
    SafeClearance=Slider(6, range=0..10),
    ZHopHeight=number_slider_6,
    Speed=Slider(60, range=0..100),
    ExtruderTemperature=Slider(208, range=0..1000),
    BedTemperature=Slider(66, range=0..100),
    MeshingResolution=number_slider_7,
    SmoothingWindow=Slider(1, range=0..100),
    Retraction=number_slider_8,
    RetractionSpeed=Slider(12, range=0..100),
    DegenerateAspectRatio=number_slider_9)

# ----
# FDM Machine
machine = FDMMachine(
    G0RapidSpeed=Slider(160, range=0..1000),
    MaxZSpeed=Slider(10, range=0..10),
    MachineBounds=box,
    Extruders=extruder,
    EndGCode=panel,
    EPosAbsRel=Slider(1, range=0..1),
    HomeBeforePrint=home,
    CenterPrintXY=center)
mode_2 = ProcessorMode({"Hybrid": 2, "Preview": 1, "Simulation": 0}, selected="Hybrid")
processor = FDMProcessor(Toolpaths=mod_ndisp, Machine=machine, Defaults=defaults, ProcessorMode=mode_2)  # -> SimulationData, Errors, Warnings
errors = Panel(processor.Errors)
warnings = Panel(processor.Warnings)
path = FilePath()

# ----
# set a directory not file
machine_2 = Machine({"Klipper": "klipper", "Klipper (No Z)": "klipper_noz", "RepRap": "reprap", "Prusa": "prusa", "Bambu": "bambu"}, selected="Klipper")
# output the gcode
fdm_g_code = FDMGCodeOutput(
    SimulationData=processor.SimulationData,
    MachineType=machine_2,
    OutputDirectory=path,
    Save=False,
    Upload=False,
    StartPrint=False,
    OutputGCode=False)  # -> GCode, Toolpath, Info, VerboseDebug, ToolpathDebug

play = BooleanToggle(False)
mesh_output = BooleanToggle(False)
progress_bar = BooleanToggle(True)
hide = BooleanToggle(False)
# display the simulation
number_slider_10 = Slider(1, range=0..1)
fdm_sim = FDMSimulator(
    SimulationData=processor.SimulationData,
    Time=number_slider_10,
    Play=play,
    Speed=Slider(4, range=0..10),
    StadiumSegments=Slider(3, range=0..10),
    BakeMeshes=mesh_output,
    ProgressOverlay=progress_bar,
    DisablePreview=hide)  # -> CurrentTime, Meshes, ToolPosition, ProgramDuration
