# Grasshopper definition seamless-cup.gh (Grasshopper 1.0.8)
# plug-ins: Toolpaths.Fdm, Toolpaths.Gh

# ----
# layerheight & width
layerheight = Slider(1, range=0..10)
width = Slider(1.6, range=0..10)
layerheight_2 = Number(layerheight)
width_2 = Number(width)

# ----
# vasemode settings
mode = Mode({"Angle": 0, "Length": 1}, selected="Angle")
vase_mode_start_lh = Slider(0.1, range=0..1)
solid_base_layers = Slider(2, range=0..10)
multiplication = Multiplication(A=layerheight_2, B=solid_base_layers)

smooth_top = BooleanToggle(True)
helix_dir = BooleanToggle(True)
fade_in = BooleanToggle(True)

pattern_strenght = Slider(1.95, range=0..5)
upper_lip_height = Slider(5, range=0..10)
pattern = Panel("""-1
1
1
-1""")

# ----
# TOOLPATHS
# developed by JÜNGERKÜHN
# contact: toolpaths@juengerkuehn.com
# juengerkuehn.com
# github.com/KonradJuenger/TOOLPATHS
# input geometry
geo = Geometry(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)

vase_options = FDMVaseOptions(
    SamplingMode=mode,
    Divisions=Slider(78, range=0..100),
    StaggerCycle=Slider(2, range=0..10),
    BaseThickness=expr("x+0.1", multiplication),
    MinimumExtrusionHeight=vase_mode_start_lh,
    FadeStart=fade_in,
    SmoothEnd=smooth_top,
    HelixDirection=helix_dir)
# generate helix
fdm_vase = FDMVaseModeGenerator(Geometry=geo, LayerHeight=layerheight_2, ExtrusionWidth=width_2, Options=vase_options)  # -> Toolpath, HelixCurve, UnsampledCurve, TopCurves, BottomCurves

# ----
# create region masks for bottom and top of cup
bbox = BoundingBox(Content=geo, Plane=PlaneXY(0, 0, 0), UnionBox=True)  # -> Box, Box_2
cluster = Cluster(C=flatten(bbox.Box))  # -> S, E, S_3, E_3, S_2, E_2
addition = Addition(A=cluster.S_2, B=multiplication)
subtraction = Subtraction(A=cluster.E_2, B=cluster.S_2)
Z = UnitZ(Factor=cluster.S_2)
xy = XYPlane(Origin=Point(0, 0, 0))
Z_2 = UnitZ(Factor=expr("x+1", cluster.E_2))
division = Division(A=upper_lip_height, B=subtraction)
xy_2 = XYPlane(Origin=Point(0, 0, 0))
move = Move(Geometry=xy, Motion=Z)  # -> Geometry, Transform
division_2 = Division(A=addition, B=subtraction)
move_2 = Move(Geometry=xy_2, Motion=Z_2)  # -> Geometry, Transform
scale_nu = ScaleNU(Geometry=bbox.Box, Plane=move.Geometry, ScaleX=1.33, ScaleY=1.33, ScaleZ=division_2)  # -> Geometry, Transform
scale_nu_2 = ScaleNU(Geometry=bbox.Box, Plane=move_2.Geometry, ScaleX=1.33, ScaleY=1.33, ScaleZ=division)  # -> Geometry, Transform
merge = Merge(Data1=scale_nu.Geometry, Data2=scale_nu_2.Geometry)

# ----
# align infill with helix start
end = EndPoints(Curve=fdm_vase.HelixCurve)  # -> Start, End

# ----
# create solid bottom with 2 layers thickness
# create solid bottom with 2 layers thickness
list = ValueList({"Monotonic": 0, "Monotonic (Connected)": 1, "Gyroid": 2, "Gyroid (Connected)": 3, "Spiral": 4}, selected="Spiral")
toggle = BooleanToggle(True)
_0 = Number(0)
width_3 = Number(width_2)
fdm_infill = FDMInfillGenerator(
    InfillCurves=fdm_vase.BottomCurves,
    InfillSpacing=width_3,
    MinLength=0,
    InfillType=list,
    InfillOffset=_0,
    StartPoint=end.Start)

tstat = TreeStatistics(Tree=fdm_infill)  # -> Paths, Length, Count
P = CullPattern([False, True])
cull = CullPattern(List=tstat.Paths, CullPattern=invert(P))
# flip the direction of every second infill
cull_2 = CullPattern(List=tstat.Paths, CullPattern=P)
branch = TreeBranch(Tree=fdm_infill, Path=cull_2, MaintainPaths=True)
branch_2 = TreeBranch(Tree=fdm_infill, Path=cull, MaintainPaths=True)
flip = FlipCurve(Curve=branch)  # -> Curve, Flag
merge_2 = Merge(Data1=branch_2, Data2=flip.Curve)  # -> flatten(Result)
connect = ConnectCurves(Curves=merge_2, Continuity=2, Close=False, Bulge=1)

# ----
# subdivide the toolpath
# to so that the pattern applies
# to each segment of the toolpath
lng = ListLength(List=pattern)
mod_subdivide = ModulatorSubdivide(
    Input=fdm_vase.Toolpath,
    SegmentLength=0,
    DivisionsPerSegment=lng,
    RemapMode=2,
    RespectClosed=True,
    SubdividePolylines=False)

# ----
# mask the top and bottom with falloff
toggle_2 = BooleanToggle(True)
maskregion = MaskFromRegion(
    Input=mod_subdivide,
    RegionGeometry=merge,
    Invert=toggle_2,
    Falloff=Slider(20, range=0..100),
    FalloffMode=Slider(2, range=0..10),
    CombinationMode=Slider(1, range=0..1),
    CombinationModeEnabled=True,
    FalloffModeEnabled=True)

multiplication_2 = Multiplication(A=pattern, B=pattern_strenght)

# ----
# apply the displacement pattern
mod_ndisp = ModulatorNormalDisplacement(Input=mod_subdivide, Distances=multiplication_2, VertexMapping=2, Mode=maskregion)

layerheight_3 = Number(layerheight_2)
# create toolpath from curve
width_4 = Number(width_2)
extrvolume = FDMExtrusionVolume(Width=width_4, Height=layerheight_3)
fdm_toolpath = FDMToolpath(Curve=connect, Volume=extrvolume)

# ----
# adjust flow for helix
number_slider = Slider(1.3, range=0..10)
fdm_toolpath_2 = FDMToolpath(Toolpath=mod_ndisp, Flow=number_slider)

# ----
# extruder
_0_2 = ExtruderNumber(0)
nozzle_diameter = NozzleDiameter(0.8)
filament_diameter = FilamentDiameter(1.75)
extruder = FDMExtruder(
    ExtruderNumber=_0_2,
    NozzleDiameter=nozzle_diameter,
    FilamentDiameter=filament_diameter,
    PrintMaterial=RGB(100, 149, 237))

# ----
# end gcode for 3d printer
# simualtion is based on a heightfield, higher res creates more samples
# Z values for first move, to prevent collisions
panel = Panel("""M104 S0; extruder OFF
M140 S0 ;Bed OFF
G91 ;relative positioning
G1 E-1 F300  ;retract filament
G1 Z+0.5 E-2 F1500 ;move up
G90  ;absolute positioning
M84 ; stepper motors off
M107 ; fan off""")
# connect toolpath for bottom and helix
# into one continous one
connect_tp = FDMConnectToolpaths(
    ConnectorMode=1,
    ParameterSource=0,
    SortToolpaths=False,
    AllowFlipToolpaths=False,
    SkipAdjacentCommands=False,
    Toolpath1=fdm_toolpath,
    Toolpath2=fdm_toolpath_2)
center = BooleanToggle(True)
home = BooleanToggle(True)

# ----
# resolution of the simulation mesh
# extrusion width is smoothed per default with moving average
# retraction of the filament after each extrusion
number_slider_2 = Slider(1, range=0..100)
# values are specific for printer
number_slider_3 = Slider(0.3, range=0..1)
# global Z hop
number_slider_4 = Slider(0.4, range=0..1)
# extrusion aspect ratio limiter
number_slider_5 = Slider(10, range=0..10)
defaults = FDMDefaults(
    HeightfieldResolution=number_slider_3,
    SafeClearance=Slider(6, range=0..10),
    ZHopHeight=number_slider_4,
    Speed=Slider(60, range=0..100),
    ExtruderTemperature=Slider(208, range=0..1000),
    BedTemperature=Slider(66, range=0..100),
    MeshingResolution=Slider(0.4, range=0..1),
    SmoothingWindow=number_slider_2,
    Retraction=Slider(0.7, range=0..1),
    RetractionSpeed=Slider(12, range=0..100),
    DegenerateAspectRatio=number_slider_5)

# ----
# FDM Machine
number_slider_6 = Slider(160, range=0..1000)
box = Box({Plane=Plane(origin=(0, 300, 0), x=(1, 0, 0), y=(0, -1, 0)), X=Domain(0, 300), Y=Domain(0, 300), Z=Domain(-400, 0)})
mode_2 = ProcessorMode({"Hybrid": 2, "Preview": 1, "Simulation": 0}, selected="Hybrid")
machine = FDMMachine(
    G0RapidSpeed=number_slider_6,
    MaxZSpeed=Slider(10, range=0..10),
    MachineBounds=box,
    Extruders=extruder,
    EndGCode=panel,
    EPosAbsRel=Slider(1, range=0..1),
    HomeBeforePrint=home,
    CenterPrintXY=center)
# central program generator
processor = FDMProcessor(Toolpaths=connect_tp, Machine=machine, Defaults=defaults, ProcessorMode=mode_2)  # -> SimulationData, Errors, Warnings
errors = Panel(processor.Errors)
warnings = Panel(processor.Warnings)
# set a directory not file
path = FilePath()

machine_2 = Machine({"Klipper": "klipper", "Klipper (No Z)": "klipper_noz", "RepRap": "reprap", "Prusa": "prusa", "Bambu": "bambu"}, selected="Klipper")
# output the gcode
fdm_g_code = FDMGCodeOutput(
    SimulationData=processor.SimulationData,
    MachineType=machine_2,
    OutputDirectory=path,
    Save=False,
    Upload=False,
    StartPrint=False,
    OutputGCode=False)  # -> GCode, Toolpath, Info, VerboseDebug, ToolpathDebug

play = BooleanToggle(False)
mesh_output = BooleanToggle(False)
progress_bar = BooleanToggle(True)
hide = BooleanToggle(False)
# display the simulation
fdm_sim = FDMSimulator(
    SimulationData=processor.SimulationData,
    Time=Slider(1, range=0..1),
    Play=play,
    Speed=Slider(4, range=0..10),
    StadiumSegments=Slider(3, range=0..10),
    BakeMeshes=mesh_output,
    ProgressOverlay=progress_bar,
    DisablePreview=hide)  # -> CurrentTime, Meshes, ToolPosition, ProgramDuration

# ==== cluster Cluster
C = ClusterInput()
bbox = BoundingBox(Content=C, Plane=PlaneXY(0, 0, 0), UnionBox=True)  # -> Box, Box_2
debox = DeconstructBox(Box=bbox.Box)  # -> Plane, X, Y, Z
dedomain = DeconstructDomain(Domain=debox.X)  # -> Start, End
dedomain_2 = DeconstructDomain(Domain=debox.Z)  # -> Start, End
dedomain_3 = DeconstructDomain(Domain=debox.Y)  # -> Start, End
S = ClusterOutput(dedomain.Start)
E = ClusterOutput(dedomain.End)
S_2 = ClusterOutput(dedomain_2.Start)
E_2 = ClusterOutput(dedomain_2.End)
S_3 = ClusterOutput(dedomain_3.Start)
E_3 = ClusterOutput(dedomain_3.End)
